# Grasshopper definition 2D Drawing Tutorial_Final_From_Recording.gh (Grasshopper 1.0.7)
# plug-ins: KUKA|prc - parametric robot control

# ---- group: PARAMETRIC GEOMETRY
number_slider = Slider(50, range=-100..100)
pt = ConstructPoint(XCoordinate=number_slider, YCoordinate=number_slider, ZCoordinate=number_slider)
cir = Circle(Plane=pt, Radius=number_slider)
divide = DivideCurve(Curve=cir, Count=Slider(25, range=-100..100), Kinks=False)  # -> Points, Tangents, Parameters
cir_2 = Circle(Plane=divide.Points, Radius=Slider(50, range=-100..100))  # -> flatten(Circle)
geo = Geometry(flatten(cir_2))

# ---- group: XYZ COORDINATES
number_slider_2 = Slider(520.54, range=0..1000)
number_slider_3 = Slider(-359.173, range=-500..800)
number_slider_4 = Slider(-6.168, range=-500..800)

# ---- group: ABC VALUES
number_slider_5 = Slider(0.005, range=-500..800)
number_slider_6 = Slider(-0.002, range=-500..800)
number_slider_7 = Slider(-0.004, range=-500..800)

# ----
number_slider_8 = Slider(0, range=0..100)
working_cell = Geometry([<point referenced from the Rhino model>, <brep referenced from the Rhino model> x69, <point referenced from the Rhino model>, <brep referenced from the Rhino model> x9])
frame = FrameKUKAPrc(
    FrameNumber=Slider(21, range=0..100),
    XValue=number_slider_2,
    YValue=number_slider_3,
    ZValue=number_slider_4,
    AValue=number_slider_5,
    BValue=number_slider_6,
    CValue=number_slider_7,
    toolaxis="Z")  # -> KUKAPrcFrame, XYZABCAsPlane
kuka_origin = ConstructPoint(XCoordinate=number_slider_2, YCoordinate=number_slider_3, ZCoordinate=number_slider_4)
world_point = ConstructPoint(XCoordinate=number_slider_8, YCoordinate=number_slider_8, ZCoordinate=number_slider_8)

# ---- group: WORKING CELL
vec2pt = Vector2Pt(PointA=kuka_origin, PointB=world_point, Unitize=False)  # -> Vector, Length
vdis = VectorDisplay(Anchor=world_point, Vector=vec2pt.Vector)
translation_vector = Vector(vec2pt.Vector)
devec = DeconstructVector(Vector=translation_vector)  # -> XComponent, YComponent, ZComponent
addition = Addition(A=devec.ZComponent, B=Slider(0, range=-100..250))
vec = VectorXYZ(XComponent=devec.XComponent, YComponent=devec.YComponent, ZComponent=addition)  # -> Vector, Length
move = Move(Geometry=working_cell, Motion=vec.Vector)  # -> Geometry, Transform
preview = CustomPreview(Geometry=move.Geometry, Material=ColourSwatch(SwatchColor=RGB(202, 109, 238)))

# ---- group: PROJECT TO WORLD ORIGIN
project = Project(Geometry=geo, Plane=PlaneXY(0, 0, 0))  # -> Geometry, Transform
area = Area(Geometry=project.Geometry)  # -> Area, Centroid
avr = Average(Input=area.Centroid)
xy = XYPlane(Origin=Point(0, 0, 0))
orient = Orient(Geometry=project.Geometry, Source=avr, Target=xy)  # -> Geometry, Transform

# ----
axis_move = AXISMovementKUKAPrc(Axis1=0, Axis2=-90, Axis3=90, Axis4=0, Axis5=0, Axis6=0, extaxenabled=False, interpolation="C_PTP")
kr6_10_r900 = AgilusKR610R900Robot(infiniterot=False)
mesh = Mesh(<mesh referenced from the Rhino model>)
custom_tool = CustomToolKUKAPrc(
    CustomToolGeometry=mesh,
    toolid=6,
    toolvala=0,
    toolvalb=0,
    toolvalc=0,
    toolvalx=0,
    toolvaly=0,
    toolvalz=170,
    valuesset=True)

# ---- group: PARAMETRIC MOVE
number_slider_9 = Slider(110, range=-500..500)
pt_2 = ConstructPoint(XCoordinate=0, YCoordinate=0, ZCoordinate=0)

# ----
addition_2 = Addition(A=number_slider_9, B=Slider(0, range=-500..500))

# ---- group: PARAMETRIC MOVE (continued)
pt_3 = ConstructPoint(XCoordinate=Slider(85, range=-500..500), YCoordinate=Slider(350, range=-500..500), ZCoordinate=addition_2)
vec2pt_2 = Vector2Pt(PointA=pt_2, PointB=pt_3, Unitize=False)  # -> Vector, Length
move_2 = Move(Geometry=orient.Geometry, Motion=vec2pt_2.Vector)  # -> Geometry, Transform

# ---- group: PLANE TOOLPATHING
topoly = CurveToPolyline(Curve=move_2.Geometry, ToleranceDistance=Slider(0.778, range=0..1), ToleranceAngle=0)  # -> Polyline, Segments
cp = ControlPoints(Curve=topoly.Polyline)  # -> Points, Weights, Knots
xz = XZPlane(Origin=cp.Points)
pflip = FlipPlane(Plane=xz, ReverseX=Toggle(False), ReverseY=Toggle(True), SwapAxes=Toggle(True))

# ---- group: POINT TO POINT MOVEMENT
item = ListItem(List=flatten(pflip), Index=0, Wrap=True)
devec_2 = DeconstructVector(Vector=item)  # -> XComponent, YComponent, ZComponent
addition_3 = Addition(A=devec_2.XComponent, B=Slider(0, range=-100..100))
addition_4 = Addition(A=devec_2.YComponent, B=Slider(0, range=-100..100))
addition_5 = Addition(A=devec_2.ZComponent, B=Slider(359, range=-100..500))
vec_2 = VectorXYZ(XComponent=addition_3, YComponent=addition_4, ZComponent=addition_5)  # -> Vector, Length
move_3 = Move(Geometry=item, Motion=vec_2.Vector)  # -> Geometry, Transform

# ---- group: DRAWING MOVEMENTS
lin_move = LINearMovementKUKAPrc(TargetAsPlane=pflip, Speed=Slider(0.02, range=0..0.1), extaxenabled=False, interpolation="C_DIS")
cartesian_offset = CartesianOffsetKUKAPrc(
    KUKAPrcCommand=lin_move,
    CartesianX=0,
    CartesianY=0,
    CartesianZ=Slider(50, range=0..100),
    OffsetStart=True,
    OffsetEnd=True,
    OffsetSpeed=Slider(0.02, range=0..0.1))

# ----
ptp_move = PTPMovementKUKAPrc(TargetAsPlane=move_3.Geometry, Speed=Slider(5, range=0..10), extaxenabled=False, interpolation="C_PTP")
kuka_prc = KUKAPrcCORE(
    SimulationSlider=Slider(1, range=0..1),
    KUKAPrcCommands=flatten([ptp_move, cartesian_offset]),
    Tool=custom_tool,
    Robot=kr6_10_r900,
    RobotBase=frame.KUKAPrcFrame,
    PRC_BaseExpose=True,
    PRC_SaveNameExpose=False,
    PRCsettings="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")  # -> RobotGeometry, AnalysisOutput
