# Grasshopper definition BrickWall Script_2.gh (Grasshopper 1.0.7)

layers = Slider(3, range=0..10)
spacing = Slider(1.2, range=0..10)
number_slider = Slider(50, range=0..100)
number_slider_2 = Slider(25, range=0..100)
number_slider_3 = Slider(25, range=0..100)
number_slider_4 = Slider(0, range=0..10)

# ---- group: old
python = GhPythonScript(x=number_slider, y=number_slider_2, z=number_slider_3, bricks=Slider(12, range=0..100), layers=layers, spacing=spacing)  # -> out, wall
# ---------- python: Python ----------
import rhinoscriptsyntax as rs
p = []

layer = int(bricks/layers)
stack = 0

s = spacing

while layers > 0:
    if stack == 0:
        for i in range(layer):
            x_c = x*i
            point = rs.AddPoint(x_c*s, 0, 0)
            p.append(point)
    elif stack % 2 != 0:
        for j in range(layer-1):
            j = j+.5
            x_c= j*x
            z_c= z*stack
            point = rs.AddPoint(x_c*s,0,z_c) 
            p.append(point)
    else:        
        for k in range(layer):
            x_c= k*x
            z_c= z*stack
            point = rs.AddPoint(x_c*s,0,z_c) 
            p.append(point)
    stack = stack + 1
    layers = layers - 1
wall = p
# ---------- end python ----------

# ----
box = DomainBox(Base=PlaneXY(0, 0, 0), X=number_slider, Y=number_slider_2, Z=number_slider_3)

# ---- group: pyramid brick script
python_2 = GhPythonScript(x=number_slider, y=number_slider_2, z=number_slider_3, bricks=Slider(3, range=0..11), spacing=spacing)  # -> out, wall; inputs bricks: Int32
# ---------- python_2: Python ----------
__author__ = "mylessampson"

import rhinoscriptsyntax as rs

p = []


stack = 0

s = spacing

if bricks == 0:
    pass
    
elif bricks == 1:
    point = rs.AddPoint(0, 0, 0)
    p.append(point)

elif bricks == 2:
        
    for b in range(bricks):
        print(b)
        x_c= b*x
        z_c= 0
        point = rs.AddPoint(x_c*s,0,z_c) 
        p.append(point)

elif bricks == 3:
    count = 0
    for b in range(bricks):
        
        if count == 2:
            print(b)
            x_c = x
            z_c= z
            point = rs.AddPoint(x_c*s/2,0,z_c) 
            p.append(point)
            
        else:
            x_c= b*x
            z_c= 0
            point = rs.AddPoint(x_c*s,0,0) 
            p.append(point)
            count += 1
            
elif bricks == 10:
    count = 0
    l = 0
    for b in range(bricks):
        
        
        if count >3 and count <=6:
            
            c = (count+.1) 
            x_c = c*x -l
            z_c= z
            point = rs.AddPoint(x_c*s,0,z_c) 
            p.append(point)
            
            l2 = x_c*s
            
            
        elif count >=7 and count <= 9:
           
            #print count
            if count == 9:
                c = (count-6)
                x_c = c*x*.5
                z_c= z*3
                point = rs.AddPoint(x_c*s,0,z_c) 
                p.append(point)
            else:
                c = (count-6)
                print (c)
                x_c = x*c
                z_c= z*2
                point = rs.AddPoint(x_c*s,0,z_c)
                l3 = x_c*s
                p.append(point)
            
        else:
            x_c= b*x
            z_c= 0
            point = rs.AddPoint(x_c*s,0,0) 
            p.append(point)
            
            l= x_c*s
            
        
            
        #print (count)
        count += 1
        
wall = p
# ---------- end python_2 ----------

# ----
panel = Panel(python_2.wall)
item = ListItem(List=python_2.wall, Index=Slider(0, range=0..10), Wrap=True)
xy = XYPlane(Origin=Point(0, 0, 0))
vec2pt = Vector2Pt(PointA=xy, PointB=python.wall, Unitize=False)  # -> Vector, Length
move = Move(Geometry=box, Motion=vec2pt.Vector)  # -> Geometry, Transform
cos = Cosine(Value=panel)
xy_2 = XYPlane(Origin=python_2.wall)
prot = RotatePlane(Plane=xy_2, Angle=cos)
