# Grasshopper definition KUKAprc_RPL_Template.gh (Grasshopper 1.0.7)
# plug-ins: KUKA|prc - parametric robot control

# ---- group: XYZ COORDINATES
number_slider = Slider(520.54, range=0..1000)
number_slider_2 = Slider(-359.173, range=-500..800)
number_slider_3 = Slider(-6.168, range=-500..800)

# ---- group: ABC VALUES
number_slider_4 = Slider(0.005, range=-500..800)
number_slider_5 = Slider(-0.002, range=-500..800)
number_slider_6 = Slider(-0.004, range=-500..800)

# ----
number_slider_7 = Slider(0, range=0..100)
working_cell = Geometry([<point referenced from the Rhino model>, <brep referenced from the Rhino model> x69, <point referenced from the Rhino model>, <brep referenced from the Rhino model> x9])
frame = FrameKUKAPrc(
    FrameNumber=Slider(21, range=0..100),
    XValue=number_slider,
    YValue=number_slider_2,
    ZValue=number_slider_3,
    AValue=number_slider_4,
    BValue=number_slider_5,
    CValue=number_slider_6,
    toolaxis="Z")  # -> KUKAPrcFrame, XYZABCAsPlane
kuka_origin = ConstructPoint(XCoordinate=number_slider, YCoordinate=number_slider_2, ZCoordinate=number_slider_3)
world_point = ConstructPoint(XCoordinate=number_slider_7, YCoordinate=number_slider_7, ZCoordinate=number_slider_7)

# ---- group: WORKING CELL
vec2pt = Vector2Pt(PointA=kuka_origin, PointB=world_point, Unitize=False)  # -> Vector, Length
vdis = VectorDisplay(Anchor=world_point, Vector=vec2pt.Vector)
translation_vector = Vector(vec2pt.Vector)
devec = DeconstructVector(Vector=translation_vector)  # -> XComponent, YComponent, ZComponent
addition = Addition(A=devec.ZComponent, B=Slider(0, range=-100..250))
vec = VectorXYZ(XComponent=devec.XComponent, YComponent=devec.YComponent, ZComponent=addition)  # -> Vector, Length
move = Move(Geometry=working_cell, Motion=vec.Vector)  # -> Geometry, Transform
preview = CustomPreview(Geometry=move.Geometry, Material=ColourSwatch(SwatchColor=RGB(202, 109, 238)))

# ----
axis_move = AXISMovementKUKAPrc(Axis1=0, Axis2=-90, Axis3=90, Axis4=0, Axis5=0, Axis6=0, extaxenabled=False, interpolation="C_PTP")
kr6_10_r900 = AgilusKR610R900Robot(infiniterot=False)
kuka_prc = KUKAPrcCORE(
    SimulationSlider=Slider(0, range=0..1),
    KUKAPrcCommands=axis_move,
    Robot=kr6_10_r900,
    RobotBase=frame.KUKAPrcFrame,
    PRC_BaseExpose=True,
    PRC_SaveNameExpose=False,
    PRCsettings="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")  # -> RobotGeometry, AnalysisOutput
