# Grasshopper definition Pick and Place Tutorial_Recording.gh (Grasshopper 1.0.7)
# plug-ins: KUKA|prc - parametric robot control, Pufferfish

# ---- group: XYZ COORDINATES
number_slider = Slider(520.54, range=0..1000)
number_slider_2 = Slider(-359.173, range=-500..800)
number_slider_3 = Slider(-6.168, range=-500..800)

# ---- group: ABC VALUES
number_slider_4 = Slider(0.005, range=-500..800)
number_slider_5 = Slider(-0.002, range=-500..800)
number_slider_6 = Slider(-0.004, range=-500..800)

# ----
number_slider_7 = Slider(0, range=0..100)
working_cell = Geometry([<point referenced from the Rhino model>, <brep referenced from the Rhino model> x69, <point referenced from the Rhino model>, <brep referenced from the Rhino model> x9])

# ---- group: PICK MAT SET-UP
crv = Curve([<curve referenced from the Rhino model> x108])
project = Project(Geometry=crv, Plane=PlaneXY(0, 0, 0))  # -> Geometry, Transform
number_slider_8 = Slider(45, range=0..100)
pt = ConstructPoint(
    XCoordinate=Slider(50, range=-500..500),
    YCoordinate=Slider(168, range=-500..500),
    ZCoordinate=Slider(0, range=-500..500))
area = Area(Geometry=project.Geometry)  # -> Area, Centroid
item = ListItem(List=area.Centroid, Index=number_slider_8, Wrap=True)
vec2pt = Vector2Pt(PointA=item, PointB=pt, Unitize=False)  # -> Vector, Length
move = Move(Geometry=crv, Motion=vec2pt.Vector)  # -> Geometry, Transform

# ----
frame = FrameKUKAPrc(
    FrameNumber=Slider(21, range=0..100),
    XValue=number_slider,
    YValue=number_slider_2,
    ZValue=number_slider_3,
    AValue=number_slider_4,
    BValue=number_slider_5,
    CValue=number_slider_6,
    toolaxis="Z")  # -> KUKAPrcFrame, XYZABCAsPlane
kuka_origin = ConstructPoint(XCoordinate=number_slider, YCoordinate=number_slider_2, ZCoordinate=number_slider_3)
world_point = ConstructPoint(XCoordinate=number_slider_7, YCoordinate=number_slider_7, ZCoordinate=number_slider_7)

# ---- group: WORKING CELL
vec2pt_2 = Vector2Pt(PointA=kuka_origin, PointB=world_point, Unitize=False)  # -> Vector, Length
vdis = VectorDisplay(Anchor=world_point, Vector=vec2pt_2.Vector)
translation_vector = Vector(vec2pt_2.Vector)
devec = DeconstructVector(Vector=translation_vector)  # -> XComponent, YComponent, ZComponent
addition = Addition(A=devec.ZComponent, B=Slider(0, range=-100..250))
vec = VectorXYZ(XComponent=devec.XComponent, YComponent=devec.YComponent, ZComponent=addition)  # -> Vector, Length
move_2 = Move(Geometry=working_cell, Motion=vec.Vector)  # -> Geometry, Transform
preview = CustomPreview(Geometry=move_2.Geometry, Material=ColourSwatch(SwatchColor=RGB(202, 109, 238)))

# ---- group: PICK LOCATION
item_2 = ListItem(List=move.Geometry, Index=number_slider_8, Wrap=True)
area_2 = Area(Geometry=item_2)  # -> Area, Centroid

# ---- group: PLACE LOCATION
item_3 = ListItem(List=move.Geometry, Index=Slider(34, range=0..118), Wrap=True)
area_3 = Area(Geometry=item_3)  # -> Area, Centroid

# ----
kr6_10_r900 = AgilusKR610R900Robot(infiniterot=False)
number_slider_9 = Slider(-45, range=-500..400)

pdecon = Deconstruct(Point=area_2.Centroid)  # -> XComponent, YComponent, ZComponent
addition_2 = Addition(A=pdecon.XComponent, B=Slider(0, range=-500..400))
addition_3 = Addition(A=pdecon.YComponent, B=Slider(0, range=-500..400))
addition_4 = Addition(A=pdecon.ZComponent, B=Slider(50, range=-500..400), C=number_slider_9)
pt_2 = ConstructPoint(XCoordinate=addition_2, YCoordinate=addition_3, ZCoordinate=addition_4)

pdecon_2 = Deconstruct(Point=area_3.Centroid)  # -> XComponent, YComponent, ZComponent
addition_5 = Addition(A=pdecon_2.XComponent, B=Slider(0, range=-500..400))
addition_6 = Addition(A=pdecon_2.YComponent, B=Slider(-14, range=-500..400))
addition_7 = Addition(A=pdecon_2.ZComponent, B=Slider(75, range=-500..400), C=number_slider_9)
pt_3 = ConstructPoint(XCoordinate=addition_5, YCoordinate=addition_6, ZCoordinate=addition_7)

spacing = Slider(1.2, range=0..10)
number_slider_10 = Slider(50, range=0..100)
number_slider_11 = Slider(25, range=0..100)
number_slider_12 = Slider(25, range=0..100)
layers = Slider(3, range=0..10)

# ---- group: TOOL / CLOSE TOOL
mesh = Mesh(<mesh referenced from the Rhino model>)
mcol = MeshColours(Mesh=mesh, Colours=ColourSwatch(SwatchColor=RGB(33, 222, 255)))
custom_tool = CustomToolKUKAPrc(
    CustomToolGeometry=mcol,
    toolid=4,
    toolvala=0,
    toolvalb=-90,
    toolvalc=0,
    toolvalx=0,
    toolvaly=0,
    toolvalz=205,
    valuesset=True)

# ---- group: TOOL / OPEN TOOL
mesh_2 = Mesh(<mesh referenced from the Rhino model>)
mcol_2 = MeshColours(Mesh=mesh_2, Colours=ColourSwatch(SwatchColor=RGB(232, 45, 255)))
custom_tool_2 = CustomToolKUKAPrc(
    CustomToolGeometry=mcol_2,
    toolid=4,
    toolvala=0,
    toolvalb=-90,
    toolvalc=0,
    toolvalx=0,
    toolvaly=0,
    toolvalz=205,
    valuesset=True)

# ----
number_slider_13 = Slider(0, range=0..10)

# ---- group: old
python = GhPythonScript(
    x=number_slider_10,
    y=number_slider_11,
    z=number_slider_12,
    bricks=Slider(12, range=0..100),
    layers=layers,
    spacing=spacing)  # -> out, wall
# ---------- python: Python ----------
import rhinoscriptsyntax as rs
p = []

layer = int(bricks/layers)
stack = 0

s = spacing

while layers > 0:
    if stack == 0:
        for i in range(layer):
            x_c = x*i
            point = rs.AddPoint(x_c*s, 0, 0)
            p.append(point)
    elif stack % 2 != 0:
        for j in range(layer-1):
            j = j+.5
            x_c= j*x
            z_c= z*stack
            point = rs.AddPoint(x_c*s,0,z_c) 
            p.append(point)
    else:        
        for k in range(layer):
            x_c= k*x
            z_c= z*stack
            point = rs.AddPoint(x_c*s,0,z_c) 
            p.append(point)
    stack = stack + 1
    layers = layers - 1
wall = p
# ---------- end python ----------

# ----
box = DomainBox(Base=PlaneXY(0, 0, 0), X=number_slider_10, Y=number_slider_11, Z=number_slider_12)
rad = Radians(Degrees=Slider(90, range=0..100))

# ---- group: pyramid brick script
python_2 = GhPythonScript(x=number_slider_10, y=number_slider_11, z=number_slider_12, bricks=Slider(3, range=0..11), spacing=spacing)  # -> out, wall; inputs bricks: Int32
# ---------- python_2: Python ----------
__author__ = "mylessampson"

import rhinoscriptsyntax as rs

p = []


stack = 0

s = spacing

if bricks == 0:
    pass
    
elif bricks == 1:
    point = rs.AddPoint(0, 0, 0)
    p.append(point)

elif bricks == 2:
        
    for b in range(bricks):
        print(b)
        x_c= b*x
        z_c= 0
        point = rs.AddPoint(x_c*s,0,z_c) 
        p.append(point)

elif bricks == 3:
    count = 0
    for b in range(bricks):
        
        if count == 2:
            print(b)
            x_c = x
            z_c= z
            point = rs.AddPoint(x_c*s/2,0,z_c) 
            p.append(point)
            
        else:
            x_c= b*x
            z_c= 0
            point = rs.AddPoint(x_c*s,0,0) 
            p.append(point)
            count += 1
            
elif bricks == 10:
    count = 0
    l = 0
    for b in range(bricks):
        
        
        if count >3 and count <=6:
            
            c = (count+.1) 
            x_c = c*x -l
            z_c= z
            point = rs.AddPoint(x_c*s,0,z_c) 
            p.append(point)
            
            l2 = x_c*s
            
            
        elif count >=7 and count <= 9:
           
            #print count
            if count == 9:
                c = (count-6)
                x_c = c*x*.5
                z_c= z*3
                point = rs.AddPoint(x_c*s,0,z_c) 
                p.append(point)
            else:
                c = (count-6)
                print (c)
                x_c = x*c
                z_c= z*2
                point = rs.AddPoint(x_c*s,0,z_c)
                l3 = x_c*s
                p.append(point)
            
        else:
            x_c= b*x
            z_c= 0
            point = rs.AddPoint(x_c*s,0,0) 
            p.append(point)
            
            l= x_c*s
            
        
            
        #print (count)
        count += 1
        
wall = p
# ---------- end python_2 ----------

# ----
panel = Panel(python_2.wall)
item_4 = ListItem(List=python_2.wall, Index=Slider(0, range=0..10), Wrap=True)

# ---- group: TOOL
ms_tool = MultiStateToolKUKAPrc(KUKAPrcTool=[custom_tool_2, custom_tool])

# ----
xy = XYPlane(Origin=Point(0, 0, 0))
vec2pt_3 = Vector2Pt(PointA=xy, PointB=python.wall, Unitize=False)  # -> Vector, Length
move_3 = Move(Geometry=box, Motion=vec2pt_3.Vector)  # -> Geometry, Transform
cos = Cosine(Value=panel)
xy_2 = XYPlane(Origin=python_2.wall)
prot = RotatePlane(Plane=xy_2, Angle=cos)
rad_2 = Radians(Degrees=Slider(90, range=0..100))
Z = UnitZ(Factor=Slider(500, range=0..500))
Z_2 = UnitZ(Factor=Slider(100, range=0..100))

# ---- group: PICK UP OBJECTS
number_slider_14 = Slider(100, range=0..100)
number_slider_15 = Slider(50, range=0..100)
number_slider_16 = Slider(50, range=0..100)
box_2 = DomainBox(Base=PlaneXY(0, 0, 0), X=number_slider_14, Y=number_slider_15, Z=number_slider_16)
debrep = DeconstructBrep(Brep=box_2)  # -> Faces, Edges, Vertices
item_5 = ListItem(List=debrep.Faces, Index=Slider(4, range=0..10), Wrap=True)
area_4 = Area(Geometry=item_5)  # -> Area, Centroid
vec2pt_4 = Vector2Pt(PointA=area_4.Centroid, PointB=pt_2, Unitize=False)  # -> Vector, Length
move_4 = Move(Geometry=box_2, Motion=vec2pt_4.Vector)  # -> Geometry, Transform

# ---- group: PLACEMENT OBJECTS
layers_2 = Slider(3, range=0..10)
spacing_2 = Slider(1.3, range=0..10)
python_3 = GhPythonScript(
    x=number_slider_14,
    y=number_slider_15,
    z=number_slider_16,
    bricks=Slider(12, range=0..100),
    layers=layers_2,
    spacing=spacing_2)  # -> out, wall; same code as python
lng = ListLength(List=python_3.wall)
rotate = Rotate(Geometry=python_3.wall, Angle=rad, Plane=PlaneXY(0, 0, 0))  # -> Geometry, Transform
item_6 = ListItem(List=rotate.Geometry, Index=0, Wrap=True)
vec2pt_5 = Vector2Pt(PointA=item_6, PointB=pt_3, Unitize=False)  # -> Vector, Length

# ---- group: PICK UP OBJECTS (continued)
series = Series(Start=0, Step=number_slider_16, Count=lng)
Z_3 = UnitZ(Factor=series)
move_5 = Move(Geometry=move_4.Geometry, Motion=Z_3)  # -> Geometry, Transform

# ----
lng_2 = ListLength(List=python_3.wall)
area_5 = Area(Geometry=move_5.Geometry)  # -> Area, reverse(Centroid)

# ---- group: PICK UP POINT
prot_2 = RotatePlane(Plane=area_5.Centroid, Angle=rad_2)

# ---- group: HEIGHT AFTER PICK UP POINT
move_6 = Move(Geometry=prot_2, Motion=Z_2)  # -> Geometry, Transform

# ---- group: PLACEMENT POINT
move_7 = Move(Geometry=rotate.Geometry, Motion=vec2pt_5.Vector)  # -> Geometry, Transform

# ---- group: VISUALIZE FINAL RESULT
rotate_2 = Rotate(Geometry=box_2, Angle=1.570796327, Plane=PlaneXY(0, 0, 0))  # -> Geometry, Transform
area_6 = Area(Geometry=rotate_2.Geometry)  # -> Area, Centroid
move2pt = MoveToPoint(Geometry=rotate_2.Geometry, PointA=area_6.Centroid, PointB=move_7.Geometry)  # -> Moved, Vector, Transform

# ---- group: HEIGHT BEFORE PLACEMENT POINT
move_8 = Move(Geometry=move_7.Geometry, Motion=Z)  # -> Geometry, Transform

# ----
# PTP MOVEMENT TO POINT ABOVE PLACEMENT OBJECT
# 10
number_slider_17 = Slider(20, range=0..20)
ptp_move = PTPMovementKUKAPrc(TargetAsPlane=move_8.Geometry, Speed=number_slider_17, extaxenabled=False, interpolation="C_PTP")

# ----
# OPEN GRIPPER
# 1
# 2
panel_2 = Panel("0")
# ;open gripper 1
# 
# WAIT SEC 1
# $OUT[2] = TRUE
# $OUT[5] = FALSE
# WAIT SEC 2
toggle = BooleanToggle(True)
digital_out = DigitalOutputKUKAPrc(DigitalOutputNumber=Slider(5, range=0..10), OutputState=Toggle(False), ContinuousMovement=False, ToolState=panel_2)
digital_out_2 = DigitalOutputKUKAPrc(DigitalOutputNumber=Slider(2, range=0..10), OutputState=toggle, ContinuousMovement=False, ToolState="0")
dup = DuplicateData(Data=digital_out, Number=lng_2, Order=True)
dup_2 = DuplicateData(Data=digital_out_2, Number=lng_2, Order=True)

# ----
# PTP MOVEMENT TO POINT ABOVE PICK UP OBJECT
# 3
number_slider_18 = Slider(20, range=0..20)
ptp_move_2 = PTPMovementKUKAPrc(TargetAsPlane=move_6.Geometry, Speed=number_slider_18, extaxenabled=False, interpolation="C_PTP")

# ----
# PTP MOVEMENT TO POINT ABOVE PLACEMENT OBJECT
# 16
number_slider_19 = Slider(20, range=0..20)
ptp_move_3 = PTPMovementKUKAPrc(TargetAsPlane=move_8.Geometry, Speed=number_slider_19, extaxenabled=False, interpolation="C_PTP")

# ----
# AXIS MOVEMENT TO RESET ARM
# 17
number_slider_20 = Slider(20, range=0..20)
axis_move = AXISMovementKUKAPrc(
    Axis1=0,
    Axis2=-90,
    Axis3=90,
    Axis4=0,
    Axis5=0,
    Axis6=0,
    Speed=number_slider_20,
    extaxenabled=False,
    interpolation="C_PTP")
dup_3 = DuplicateData(Data=axis_move, Number=lng_2, Order=True)

# ----
# PTP MOVEMENT TO POINT ABOVE PICK UP OBJECT
# 9
number_slider_21 = Slider(20, range=0..20)
ptp_move_4 = PTPMovementKUKAPrc(TargetAsPlane=move_6.Geometry, Speed=number_slider_21, extaxenabled=False, interpolation="C_PTP")

# ----
# TURN OFF THE CLOSE STATE INPUTS
# 14
# 15
toggle_2 = BooleanToggle(False)
digital_out_3 = DigitalOutputKUKAPrc(DigitalOutputNumber=Slider(5, range=0..10), OutputState=toggle_2, ContinuousMovement=False, ToolState="0")
wait = WaitKUKAPrc(KUKAPrcWait=Slider(1, range=0..1))
dup_4 = DuplicateData(Data=digital_out_3, Number=lng_2, Order=True)
dup_5 = DuplicateData(Data=wait, Number=lng_2, Order=True)

# ----
# TURN ON THE OPEN STATE INPUTS
# 12
# 13
number_slider_22 = Slider(2, range=0..10)
# ;open gripper 1
# 
# WAIT SEC 1
# $OUT[2] = TRUE
# $OUT[5] = FALSE
# WAIT SEC 2
panel_3 = Panel("0")
wait_2 = WaitKUKAPrc(KUKAPrcWait=Slider(1, range=0..1))
digital_out_4 = DigitalOutputKUKAPrc(DigitalOutputNumber=number_slider_22, OutputState=Toggle(True), ContinuousMovement=False, ToolState=panel_3)
dup_6 = DuplicateData(Data=wait_2, Number=lng_2, Order=True)
dup_7 = DuplicateData(Data=digital_out_4, Number=lng_2, Order=True)

# ----
# TURN OFF THE OPEN STATE INPUTS
# 5
# ;close gripper 1
# 
# WAIT SEC 1
# $OUT[2] = FALSE
# $OUT[5] = TRUE
# WAIT SEC 2
# 6
number_slider_23 = Slider(2, range=0..10)
wait_3 = WaitKUKAPrc(KUKAPrcWait=Slider(1, range=0..1))
digital_out_5 = DigitalOutputKUKAPrc(DigitalOutputNumber=number_slider_23, OutputState=Toggle(False), ContinuousMovement=False, ToolState="1")
dup_8 = DuplicateData(Data=wait_3, Number=lng_2, Order=True)
dup_9 = DuplicateData(Data=digital_out_5, Number=lng_2, Order=True)

# ----
# TURN ON THE CLOSE STATE INPUTS
# 7
# 8
toggle_3 = BooleanToggle(True)
digital_out_6 = DigitalOutputKUKAPrc(DigitalOutputNumber=Slider(5, range=0..10), OutputState=toggle_3, ContinuousMovement=False, ToolState="1")
wait_4 = WaitKUKAPrc(KUKAPrcWait=Slider(1, range=0..1))
dup_10 = DuplicateData(Data=wait_4, Number=lng_2, Order=True)
dup_11 = DuplicateData(Data=digital_out_6, Number=lng_2, Order=True)

# ----
# LINEAR MOVEMENT TO PICK UP POINT
# 4
# CLOSE GRIPPER
number_slider_24 = Slider(0.02, range=0..0.1)
lin_move = LINearMovementKUKAPrc(TargetAsPlane=prot_2, Speed=number_slider_24, extaxenabled=False, interpolation="C_DIS")

# ----
# LINEAR MOVEMENT TO PLACEMENT POINT
# 11
# OPEN GRIPPER
number_slider_25 = Slider(0.02, range=0..0.1)
lin_move_2 = LINearMovementKUKAPrc(TargetAsPlane=move_7.Geometry, Speed=number_slider_25, extaxenabled=False, interpolation="C_DIS")

cmd_weave = CommandWeaverKUKAPrc(
    Command1=dup_2,
    Command2=dup,
    Command3=ptp_move_2,
    Command4=lin_move,
    Command5=dup_8,
    Command6=dup_9,
    Command7=dup_11,
    Command8=dup_10,
    Command9=ptp_move_4,
    Command10=ptp_move,
    Command11=lin_move_2,
    Command12=dup_6,
    Command13=dup_7,
    Command14=dup_4,
    Command15=dup_5,
    Command16=ptp_move_3,
    Command17=dup_3,
    enabletree=False)
kuka_prc = KUKAPrcCORE(
    SimulationSlider=Slider(0, range=0..1),
    KUKAPrcCommands=cmd_weave,
    Tool=ms_tool,
    Robot=kr6_10_r900,
    RobotBase=frame.KUKAPrcFrame,
    PRC_BaseExpose=True,
    PRC_SaveNameExpose=False,
    PRCsettings="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")  # -> RobotGeometry, AnalysisOutput
