# Grasshopper definition Suction Cup Pick and Place w Planar Rotations speed update.gh (Grasshopper 1.0.7)
# plug-ins: KUKA|prc - parametric robot control

# ---- group: PICK-UP AREA
crv = Curve([<curve referenced from the Rhino model> x3])
area = Area(Geometry=crv)  # -> Area, Centroid
pt = ConstructPoint(XCoordinate=Slider(170, range=0..500), YCoordinate=Slider(168, range=0..500), ZCoordinate=Slider(0, range=0..500))
item = ListItem(List=area.Centroid, Index=Slider(0, range=0..10), Wrap=True)
vec2pt = Vector2Pt(PointA=item, PointB=pt, Unitize=False)  # -> Vector, Length
move = Move(Geometry=crv, Motion=vec2pt.Vector)  # -> Geometry, Transform

# ----
working_cell = Geometry([<point referenced from the Rhino model>, <brep referenced from the Rhino model> x69, <point referenced from the Rhino model>, <brep referenced from the Rhino model> x9])

# ---- group: XYZ COORDINATES
number_slider = Slider(-359.173, range=-500..800)
number_slider_2 = Slider(520.54, range=0..1000)
number_slider_3 = Slider(-6.168, range=-500..800)

# ----
number_slider_4 = Slider(0, range=0..100)

# ---- group: ABC VALUES
number_slider_5 = Slider(0.005, range=-500..800)
number_slider_6 = Slider(-0.002, range=-500..800)
number_slider_7 = Slider(-0.004, range=-500..800)

# ---- group: PLACEMENT GEOMETRY
geo = Geometry([<brep referenced from the Rhino model> x16])

# ----
pt_2 = Point(<point referenced from the Rhino model>)
pdecon = Deconstruct(Point=pt_2)  # -> XComponent, YComponent, ZComponent
panel = Panel(pdecon.XComponent)
frame = FrameKUKAPrc(
    FrameNumber=Slider(21, range=0..100),
    XValue=number_slider_2,
    YValue=number_slider,
    ZValue=number_slider_3,
    AValue=number_slider_5,
    BValue=number_slider_6,
    CValue=number_slider_7,
    toolaxis="Z")  # -> KUKAPrcFrame, XYZABCAsPlane
kuka_origin = ConstructPoint(XCoordinate=number_slider_2, YCoordinate=number_slider, ZCoordinate=number_slider_3)
world_point = ConstructPoint(XCoordinate=number_slider_4, YCoordinate=number_slider_4, ZCoordinate=number_slider_4)

# ---- group: WORKING CELL
vec2pt_2 = Vector2Pt(PointA=kuka_origin, PointB=world_point, Unitize=False)  # -> Vector, Length
vdis = VectorDisplay(Anchor=world_point, Vector=vec2pt_2.Vector)
translation_vector = Vector(vec2pt_2.Vector)
devec = DeconstructVector(Vector=translation_vector)  # -> XComponent, YComponent, ZComponent
addition = Addition(A=devec.ZComponent, B=Slider(0, range=-100..250))
vec = VectorXYZ(XComponent=devec.XComponent, YComponent=devec.YComponent, ZComponent=addition)  # -> Vector, Length
move_2 = Move(Geometry=working_cell, Motion=vec.Vector)  # -> Geometry, Transform
preview = CustomPreview(Geometry=move_2.Geometry, Material=ColourSwatch(SwatchColor=RGB(202, 109, 238)))

# ---- group: PICK UP SPOT
item_2 = ListItem(List=move.Geometry, Index=Slider(2, range=0..3), Wrap=True)
area_2 = Area(Geometry=item_2)  # -> Area, Centroid
pdecon_2 = Deconstruct(Point=area_2.Centroid)  # -> XComponent, YComponent, ZComponent
number_slider_8 = Slider(-25, range=-500..500)
addition_2 = Addition(A=pdecon_2.XComponent, B=number_slider_8)
addition_3 = Addition(A=pdecon_2.ZComponent, B=Slider(0, range=0..500))
addition_4 = Addition(A=pdecon_2.YComponent, B=number_slider_8)
pt_3 = ConstructPoint(XCoordinate=addition_2, YCoordinate=addition_4, ZCoordinate=addition_3)

# ---- group: TOOL
mesh = Mesh(<mesh referenced from the Rhino model>)
mesh_2 = Mesh(<mesh referenced from the Rhino model>)
mcol = MeshColours(Mesh=mesh, Colours=ColourSwatch(SwatchColor=RGB(108, 235, 218)))
mcol_2 = MeshColours(Mesh=mesh_2, Colours=ColourSwatch(SwatchColor=RGB(235, 108, 207)))
custom_tool = CustomToolKUKAPrc(
    CustomToolGeometry=mcol,
    toolid=2,
    toolvala=0.567,
    toolvalb=-0.714,
    toolvalc=0,
    toolvalx=127.599,
    toolvaly=8.613,
    toolvalz=126.475,
    valuesset=True)
custom_tool_2 = CustomToolKUKAPrc(
    CustomToolGeometry=mcol_2,
    toolid=2,
    toolvala=0.567,
    toolvalb=-0.714,
    toolvalc=0,
    toolvalx=127.599,
    toolvaly=8.613,
    toolvalz=126.475,
    valuesset=True)
ms_tool = MultiStateToolKUKAPrc(KUKAPrcTool=[custom_tool, custom_tool_2])

# ---- group: PLACEMENT SPOT
item_3 = ListItem(List=move.Geometry, Index=Slider(1, range=0..3), Wrap=True)
area_3 = Area(Geometry=item_3)  # -> Area, Centroid
pdecon_3 = Deconstruct(Point=area_3.Centroid)  # -> XComponent, YComponent, ZComponent
number_slider_9 = Slider(91, range=0..500)
number_slider_10 = Slider(0, range=0..500)
addition_5 = Addition(A=pdecon_3.XComponent, B=Slider(0, range=-100..0))
addition_6 = Addition(A=pdecon_3.ZComponent, B=Slider(0, range=0..500))
addition_7 = Addition(A=pdecon_3.YComponent, B=Slider(-26.458, range=-1000..0))
pt_4 = ConstructPoint(XCoordinate=addition_5, YCoordinate=addition_7, ZCoordinate=addition_6)

# ----
number_slider_11 = Slider(-100, range=-100..0)

# ---- group: PLACMENT OBJECTS
item_4 = ListItem(List=geo, Index=Slider(1, range=0..10), Wrap=True)
debrep = DeconstructBrep(Brep=item_4)  # -> Faces, Edges, Vertices
item_5 = ListItem(List=debrep.Faces, Index=Slider(4, range=0..10), Wrap=True)
area_4 = Area(Geometry=item_5)  # -> Area, Centroid
vec2pt_3 = Vector2Pt(PointA=area_4.Centroid, PointB=pt_4, Unitize=False)  # -> Vector, Length
move_3 = Move(Geometry=geo, Motion=vec2pt_3.Vector)  # -> Geometry, Transform

# ---- group: ROBOT
kr6_10_r900 = AgilusKR610R900Robot(infiniterot=False)

# ----
area_5 = Area(Geometry=move_3.Geometry)  # -> Area, Centroid

# ---- group: Retrieve Rotated Based Planes
debrep_2 = DeconstructBrep(Brep=move_3.Geometry)  # -> Faces, Edges, Vertices
item_6 = ListItem(List=debrep_2.Faces, Index=5, Wrap=True)
drec = DeconstuctRectangle(Rectangle=item_6)  # -> flatten(BasePlane), XInterval, YInterval

# ----
lng = ListLength(List=geo)

# ---- group: PICK-UP OBJECTS
number_slider_12 = Slider(50, range=0..100)
box = DomainBox(Base=pt_3, X=number_slider_12, Y=number_slider_12, Z=number_slider_12)
series = Series(Start=0, Step=number_slider_12, Count=lng)
Z = UnitZ(Factor=series)
move_4 = Move(Geometry=box, Motion=Z)  # -> reverse(Geometry), Transform

# ----
dup = DuplicateData(Data=box, Number=lng, Order=True)
area_6 = Area(Geometry=dup)  # -> Area, Centroid
multiplication = Multiplication(A=90, B=Slider(4, range=0..10))
lng_2 = ListLength()
deg = Degrees(Radians=Slider(360, range=0..1000))

# ---- group: PICK UP POINT
prot = RotatePlane(Plane=area_6.Centroid, Angle=deg)

# ---- group: PLACEMENT
prot_2 = RotatePlane(Plane=area_5.Centroid, Angle=deg)

# ----
Z_2 = UnitZ(Factor=Slider(200, range=0..500))
Z_3 = UnitZ(Factor=Slider(100, range=0..100))
Z_4 = UnitZ(Factor=Slider(20, range=0..100))

# ---- group: LOW
move_5 = Move(Geometry=prot, Motion=Z_4)  # -> Geometry, Transform

# ---- group: HEIGHT AFTER PICK UP POINT
move_6 = Move(Geometry=prot, Motion=Z_3)  # -> Geometry, Transform

# ----
Z_5 = UnitZ(Factor=Slider(20, range=0..500))

# ---- group: LOW
move_7 = Move(Geometry=prot_2, Motion=Z_5)  # -> Geometry, Transform

# ---- group: HEIGHT BEFORE PLACEMENT POINT
move_8 = Move(Geometry=prot_2, Motion=Z_2)  # -> Geometry, Transform

# ---- group: PLACE OBJECTS
wait = WaitKUKAPrc(KUKAPrcWait=Slider(1, range=0..10))
wait_2 = WaitKUKAPrc(KUKAPrcWait=Slider(1, range=0..10))
digital_out = DigitalOutputKUKAPrc(
    DigitalOutputNumber=Slider(13, range=0..100),
    OutputState=Toggle(False),
    ContinuousMovement=False,
    ToolState=Slider(0, range=0..1))
dup_2 = DuplicateData(Data=digital_out, Number=lng, Order=True)
dup_3 = DuplicateData(Data=wait, Number=lng, Order=True)
dup_4 = DuplicateData(Data=wait_2, Number=lng, Order=True)

# ---- group: TURN OFF SUCTION
digital_out_2 = DigitalOutputKUKAPrc(
    DigitalOutputNumber=Slider(13, range=0..100),
    OutputState=Toggle(False),
    ContinuousMovement=False,
    ToolState=Slider(0, range=0..100))
dup_5 = DuplicateData(Data=digital_out_2, Number=lng, Order=True)

# ---- group: PICK UP CLEARANCE 1
ptp_move = PTPMovementKUKAPrc(TargetAsPlane=move_6.Geometry, Speed=Slider(20, range=0..100), extaxenabled=False, interpolation="C_PTP")

# ---- group: PLACE OBJECTS / LINEAR MOVEMENT TO PLACEMENT POINT
lin_move = LINearMovementKUKAPrc(TargetAsPlane=prot_2, Speed=Slider(0.03, range=0..0.1), extaxenabled=False, interpolation="C_DIS")

# ----
lin_move_2 = LINearMovementKUKAPrc(TargetAsPlane=move_5.Geometry, Speed=Slider(0.1, range=0..0.1), extaxenabled=False, interpolation="C_DIS")

# ---- group: PICK UP OPERATION
wait_3 = WaitKUKAPrc(KUKAPrcWait=Slider(1, range=0..10))
digital_out_3 = DigitalOutputKUKAPrc(
    DigitalOutputNumber=Slider(13, range=0..100),
    OutputState=Toggle(True),
    ContinuousMovement=False,
    ToolState=Slider(1, range=0..1))
wait_4 = WaitKUKAPrc(KUKAPrcWait=Slider(1, range=0..10))
dup_6 = DuplicateData(Data=wait_4, Number=lng, Order=True)
dup_7 = DuplicateData(Data=digital_out_3, Number=lng, Order=True)
dup_8 = DuplicateData(Data=wait_3, Number=lng, Order=True)

# ---- group: ROTATION RESET
axis_move = AXISMovementKUKAPrc(
    Axis1=0,
    Axis2=-90,
    Axis3=90,
    Axis4=0,
    Axis5=0,
    Axis6=0,
    Speed=Slider(80, range=0..100),
    extaxenabled=False,
    interpolation="C_PTP")
dup_9 = DuplicateData(Data=axis_move, Number=lng, Order=True)

# ---- group: MOVEMENT TO POST PICK UP CLEARANCE
ptp_move_2 = PTPMovementKUKAPrc(TargetAsPlane=move_6.Geometry, Speed=Slider(60, range=0..100), extaxenabled=False, interpolation="C_PTP")

# ----
lin_move_3 = LINearMovementKUKAPrc(TargetAsPlane=move_7.Geometry, Speed=Slider(0.09, range=0..0.1), extaxenabled=False, interpolation="C_DIS")

# ---- group: MOVEMENT TO PLACEMENT CLEARANCE
ptp_move_3 = PTPMovementKUKAPrc(TargetAsPlane=move_8.Geometry, Speed=Slider(60, range=0..100), extaxenabled=False, interpolation="C_PTP")

# ---- group: LINEAR MOVEMENT TO PICK UP POINT
lin_move_4 = LINearMovementKUKAPrc(TargetAsPlane=prot, Speed=Slider(0.05, range=0..0.1), extaxenabled=False, interpolation="C_DIS")

# ----
lin_move_5 = LINearMovementKUKAPrc(TargetAsPlane=move_7.Geometry, Speed=Slider(0.04, range=0..0.1), extaxenabled=False, interpolation="C_DIS")

# ---- group: MOVEMENT TO POST PLACE CLEARANCE
ptp_move_4 = PTPMovementKUKAPrc(TargetAsPlane=move_8.Geometry, Speed=Slider(60, range=0..100), extaxenabled=False, interpolation="C_PTP")

# ----
cmd_weave = CommandWeaverKUKAPrc(
    Command1=dup_5,
    Command2=ptp_move,
    Command3=lin_move_2,
    Command4=lin_move_4,
    Command5=dup_6,
    Command6=dup_7,
    Command7=dup_8,
    Command8=ptp_move_2,
    Command9=ptp_move_3,
    Command10=lin_move_3,
    Command11=lin_move,
    Command12=dup_4,
    Command13=dup_2,
    Command14=dup_3,
    Command15=lin_move_5,
    Command16=ptp_move_4,
    Command17=dup_9,
    enabletree=False)
kuka_prc = KUKAPrcCORE(
    SimulationSlider=Slider(0.196, range=0..1),
    KUKAPrcCommands=cmd_weave,
    Tool=ms_tool,
    Robot=kr6_10_r900,
    RobotBase=frame.KUKAPrcFrame,
    PRC_BaseExpose=True,
    PRC_SaveNameExpose=False,
    PRCsettings="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")  # -> RobotGeometry, AnalysisOutput
